# Grasshopper definition getSiteData.gh (Grasshopper 1.0.7)

panel = Panel("""{
  "serviceKey": "LhVMAvf7G82KFeNYzgE28ylo5LVFxX6K%2F2XBtOGTyFbcIzWgF3UKcafqjFyKtZIOIsZDrK9ItETvlAlHait3sg%3D%3D",
  "typeName": "F171",
  "bbox": "197977.042,451073.098,198432.41,451515.861",
  "maxFeatures": "10",
  "srsName": "EPSG:5174",
  "resultType": "results"
}""")
# https://www.food4rhino.com/en/app/swiftlet
# Swiftlet | Food4Rhino
panel_2 = Panel("https://apis.data.go.kr/1611000/nsdi/GisBuildingService/wfs/getGisGnrlBuildingWFS")
get = GhPythonScript(buildingsUrl=panel_2, buildingsParams=panel)  # -> out, data
# ---------- get: Python ----------
__author__ = "jaeun"
__version__ = "2022.03.25"
from System.Net import WebRequest
from System.Text import ASCIIEncoding
from System.IO import StreamReader
from System.Net import ServicePointManager
from System.Net import SecurityProtocolType
from System.Net import WebException
from struct import unpack

from Grasshopper.Kernel.Types import GH_GeometryGroup
from Grasshopper.Kernel import GH_Convert

import json
import time
import binascii

import rhinoscriptsyntax as rs
import Rhino as rc


def http(method, url, data_string=None, header={}, retry=3):
    ServicePointManager.SecurityProtocol |= SecurityProtocolType.Tls11 | SecurityProtocolType.Tls12
    request = WebRequest.Create(url)
    request.UseDefaultCredentials = True
    request.Method = method
    request.ContentLength = 0
    request.Headers.Add('Access-Control-Allow-Origin', '*')
    request.Timeout = 1000000000
    
    for k,v in header.items():
        request.Headers.Add(k,v)
       
    if data_string:
        request.ContentType = "text"
        encoding = ASCIIEncoding()
        data = encoding.GetBytes(data_string)
        request.ContentLength = data.Length
        stream = request.GetRequestStream()
        stream.Write(data, 0, data.Length)
        stream.Close()

    try:
        response = request.GetResponse()
        print (response.StatusDescription)
        dataStream = response.GetResponseStream()
        reader = StreamReader(dataStream)
    
        responseFromServer = reader.ReadToEnd()
            
        reader.Close()
        dataStream.Close()
        response.Close()
        return responseFromServer

    except WebException as e : 
        if e.Response.StatusDescription == "Not Found" and retry>0:
            time.sleep(10)
            return http(method, url, data_string, header, retry-1)

        print (e.Response.StatusDescription)
        dataStream = e.Response.GetResponseStream()
        reader = StreamReader(dataStream)
    
        responseFromServer = reader.ReadToEnd()
        print (responseFromServer)
    
        reader.Close()
        dataStream.Close()


buildingsParamsJson = json.loads(buildingsParams)

buildingsUrlWithParams = buildingsUrl + "?"
for key in buildingsParamsJson:
    buildingsUrlWithParams += key + "=" + buildingsParamsJson[key] + "&"

buildingsUrlWithParams = buildingsUrlWithParams[:-1]
print(buildingsUrlWithParams)

res = http("get", buildingsUrlWithParams, retry=3)

data = res
# ---------- end get ----------
panel_3 = Panel(get.data)
python = GhPythonScript(raw_xml=panel_3)  # -> out, parsed_xml
# ---------- python: Python ----------
__author__ = "jaeun"
__version__ = "2023.05.30"

import rhinoscriptsyntax as rs
import xml.etree.ElementTree as ET



parsed_xml = ET.fromstring(raw_xml.encode("utf-8"))
# ---------- end python ----------
panel_4 = Panel(python.parsed_xml)
